# Grasshopper definition assembly_design.ghx (Grasshopper 1.0.8)
# plug-ins: RhinoCodePluginGH

compas = Python3Script()  # -> out
# ---------- compas: Python ----------
import compas
print(compas.__version__)
# ---------- end compas ----------

# ----
# Generate brick parts
list = ValueList({"none", "full", "insulated"}, selected="full")
part = Python3Script()  # -> out, full_brick, insulated_brick
# ---------- part: Python ----------
import os
from compas.geometry import Frame, Box
from compas.datastructures import Mesh
from climate_active_envelopes.assembly import CAEPart as Part



#full_brick
length, width, height = 0.24, 0.115, 0.075
full_brick = Part.from_dimensions(length=length, width=width, height=height)
full_brick.attributes['name'] = "full_brick"
#print(full_brick.attributes)
print(full_brick.__data__)

#insulated_brick_placeholder
length, width, height = 0.245, 0.12, 0.075
insulated_brick = Part.from_dimensions(length=length, width=width, height=height)
insulated_brick.attributes['name'] = "insulated_brick"
print(insulated_brick.__data__)



#insulated_brick
# package_path = ghdoc.Path
# data_path = os.path.abspath(os.path.join(package_path,"../../../climate_active_envelopes/data/brick_types"))
# filename = 'insulated_brick_reduced.stl'
# insulated_brick_mesh = Mesh.from_stl(os.path.join(data_path, filename))
# insulated_brick = Part.from_mesh_and_frame(insulated_brick_mesh)
# insulated_brick.attributes['name'] = "insulated_brick"
# #print(insulated_brick.__data__)
# ---------- end part ----------
draw = Python3Script(full_brick=part.full_brick, insulated_brick=part.insulated_brick, show=list)  # -> M, P
# ---------- draw: Python ----------
from compas_rhino.conversions import mesh_to_rhino, box_to_rhino, frame_to_rhino
from climate_active_envelopes.assembly import CAEPart as Part
from compas.geometry import Frame
from compas.geometry import Vector
from compas.geometry import Box


if show=="full":

    #extract the mesh of the part for visulization
    compas_mesh_full = full_brick.mesh

    #convert to rhino mesh
    M = mesh_to_rhino(compas_mesh_full)

    #extract and convert to rhino plane
    P = frame_to_rhino(full_brick.frame)
    #brick_full.gripping_frame = full_brick.frame
    #print(full_brick.__data__)
    print(type(full_brick))

    
elif show == "insulated":
    
    #extract the mesh of the part for visulization
    compas_mesh_insulated = insulated_brick.mesh

    #convert to rhino mesh
    M = mesh_to_rhino(compas_mesh_insulated)
    
    #extract and convert to rhino plane
    P = frame_to_rhino(insulated_brick.frame)

else:
    pass
# ---------- end draw ----------
mesh = Mesh(draw.M)
pln = Plane(draw.P)

# ----
# Unload Python modules
button = Button()
unload = Python3Script(unload=button)  # -> out, a
# ---------- unload: Python ----------
from compas_ghpython import unload_modules

unload_modules('climate_active_envelopes')
unload_modules('assembly_information_model')
# ---------- end unload ----------

list_2 = ValueList({"rotate", "translate"}, selected="translate")

total_length = Panel(compas)
geometry_input = Brep(<brep referenced from the Rhino model>)

# ----
# Slicing mesh input
layer_height = Slider(0.1, range=0..1)
contour = Python3Script(brep=geometry_input, layer_height=layer_height)  # -> out, contour_curves; inputs brep: Mesh, layer_height: Double
# ---------- contour: Python ----------
import Rhino.Geometry as rg

mesh = brep

vertices = mesh.Vertices
pt_base = vertices[0]
pt_end = vertices[2]


pt_base = vertices[0]
pt_end = vertices[1]


start_plane = rg.Plane(pt_base, rg.Vector3d(0, 0, 1))
end_plane = rg.Plane(pt_end, rg.Vector3d(0, 0, 1))

contour_curves =rg.Mesh.CreateContourCurves(mesh, pt_base,  pt_end, layer_height)
# ---------- end contour ----------
crv = Curve(contour.contour_curves)

# ----
# Shading Simulation
toggle = BooleanToggle(True)
number_slider = Slider(0, range=0..360)
epw_file = FilePath("C:\Users\julia\Downloads\DEU_BY_Munich-Theresienwiese.108650_TMYx\DEU_BY_Munich-Theresienwiese.108650_TMYx.epw")
context_input = Brep([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])
number_slider_2 = Slider(0.2, range=0..1)
sun_hours = SunHours(
    start_month=Slider(7, range=0..10),
    start_day=Slider(1, range=0..10),
    start_hour=Slider(11, range=0..100),
    end_month=Slider(8, range=0..10),
    end_day=Slider(31, range=0..100),
    end_hour=Slider(16, range=0..100),
    north=number_slider,
    geometry=geometry_input,
    epw_file=epw_file,
    context=context_input,
    grid_size=Slider(0.04, range=0..0.1),
    offset_dist=number_slider_2,
    run=toggle)  # -> hoys, location, sky_mtx, results, mesh, legend

# ----
# Create empty assembly datastructure
button_2 = Button()
assembly = Python3Script(init=button_2)  # -> out, my_assembly
# ---------- assembly: Python ----------
from climate_active_envelopes.assembly import CAEAssembly as Assembly

#create empty assembly
my_assembly = Assembly()
# ---------- end assembly ----------

previous_face = Button()
# Classification of the building components
next_face = Button()
reset = Button()

geo = Geometry(sun_hours.legend)

visualize = Python3Script(show=Toggle(False), mesh=sun_hours.mesh)  # -> out, M
# ---------- visualize: Python ----------
if show == True:
    M = mesh
# ---------- end visualize ----------
mesh_2 = Mesh(visualize.M)

panel = Panel(geo)

# ----
# Create brick assembly
list_3 = ValueList({"Flemish bond": "flemish_bond", "Vertical bond": "vertical_bond", "Fench bond": "french_bond", "generate_flemish_for_cellnetwork"}, selected="generate_flemish_for_cellnetwork")
list_4 = ValueList({"Single layer": "single_layer", "Double layer": "double_layer"}, selected="Single layer")
create_assembly = Python3Script(
    bond_type=list_3,
    wall_system=list_4,
    my_assembly=assembly.my_assembly,
    brick_full=part.full_brick,
    brick_insulated=part.insulated_brick,
    contour_curves=crv,
    brick_spacing=Slider(0.02, range=0..0.1))  # -> out, my_assembly; inputs contour_curves: list of Curve, brick_spacing: Double
# ---------- create_assembly: Python ----------
my_assembly.generate_wall(bond_type,
                        wall_system, 
                        brick_full, 
                        brick_insulated,
                        contour_curves,
                        brick_spacing
                        )
# ---------- end create_assembly ----------

get_centroids = Python3Script(my_assembly=create_assembly.my_assembly, transform_type=list_2)  # -> out, my_assembly, keys; inputs transform_type: String
# ---------- get_centroids: Python ----------
from compas.geometry import Frame, Translation, Rotation, Transformation, Point
from compas_rhino.conversions import plane_to_compas_frame, point_to_compas

import math
import Rhino.Geometry as rg

values = []
keys = []


for key in my_assembly.graph.nodes_where({"transform_type": transform_type}):
    part = my_assembly.part(key)
    keys.append(key)

my_assembly = my_assembly
# ---------- end get_centroids ----------

# ----
# Apply Gradient
vals = Python3Script(results=sun_hours.results)  # -> out, color_values; inputs results: list
# ---------- vals: Python ----------
from compas.itertools import normalize_values



def normalize_to_highest(values, max_value=140.0, target_min=0.0, target_max=1.0):
    """Normalizes a list of values based on the highest value in the list, 
    scaled to a specific range.

    Args:
    values: A list of numerical values.
    max_value: The expected maximum value. Defaults to 116.0.
    target_min: The minimum value of the target range. Defaults to 0.0.
    target_max: The maximum value of the target range. Defaults to 0.7.

    Returns:
    A list of normalized values.
    """
    highest_value = max(values)
    factor = highest_value / max_value  # Calculate the scaling factor
    normalized_values = normalize_values(values, target_min, target_max * factor)
    return normalized_values


color_values = normalize_to_highest(results)

#color_values = normalize_values(results, 0.0, 0.7)
print(color_values)




"""
color_points = []

for i, point in enumerate(points):
    frame = Frame([color_values[i], point[1] , point[2]], [1,0,0], [0,1,0])
    
    color_points.append(frame.point)
"""
# ---------- end vals ----------
panel_2 = Panel(vals.color_values)
apply_gradient = Python3Script(
    my_assembly=get_centroids.my_assembly,
    values=vals.color_values,
    keys=get_centroids.keys,
    transform_type=list_2,
    transform=Button())  # -> out, my_assembly; inputs values: list, keys: list
# ---------- apply_gradient: Python ----------
import math
import Rhino.Geometry as rg
from compas.geometry import Frame, Point
from compas.geometry import Transformation, Rotation, Translation


#print(my_assembly.apply_gradient(values, keys, transform_type_))


#print(my_assembly.__data__)

#transform_types = {node_id: my_assembly.graph.node_attribute(node_id, 'transform_type') for node_id in my_assembly.graph.nodes()}


if transform:
    assembly = my_assembly
    my_assembly.apply_gradient(values, keys, transform_type)

    #print(test)
# ---------- end apply_gradient ----------

z = Slider(-0.41, range=-3..3)
y = Slider(1.32, range=0..3)
x = Slider(0, range=0..3)
crv_2 = Curve(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)
pln_2 = Plane(Plane(origin=(-14.74086668, 24.62869101, -0.3574083905), x=(0, 1, 0), y=(-1, 0, 0)))

# ----
# Sun Path
number_slider_3 = Slider(0.3, range=0..10)
pt = Point(Point(-0.1120708673, 31.05692892, 0))
sunpath = LBSunPath(north=number_slider, location=sun_hours.location, hoys=sun_hours.hoys, center_pt=pt, scale=number_slider_3)  # -> report, vectors, altitudes, azimuths, hoys, sun_pts, analemma, daily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; plug-in component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
geo_2 = Geometry([sunpath.compass, sunpath.daily, sunpath.analemma, sunpath.legend, sunpath.title, sunpath.sun_pts])

list_5 = ValueList({"Single layer": "single_layer", "Double layer": "double_layer"}, selected="Single layer")

show_face_neighbor_until_key = BooleanToggle(False)
show_inner_wall_neighbors = BooleanToggle(False)
show_wall_neighbors = BooleanToggle(False)
show_slab_neighbors = BooleanToggle(False)
show_face_neighbor = BooleanToggle(False)

# ----
# Transform
toggle_2 = BooleanToggle(False)
pln_3 = Plane(PlaneXY(2.43007085, -1.968439302, -0.2055923429))
transform = Python3Script(my_assembly=apply_gradient.my_assembly, transform=toggle_2, origin_plane=pln, new_origin_plane=pln_3)  # -> out, my_assembly
# ---------- transform: Python ----------
from compas.geometry import Frame, Transformation, Rotation, Translation
from compas_rhino.conversions import plane_to_compas_frame


new_origin_frame = plane_to_compas_frame(new_origin_plane)
origin_frame = plane_to_compas_frame(origin_plane)

if transform:
    T = Transformation.from_frame_to_frame(origin_frame, new_origin_frame)
    my_assembly = my_assembly.transformed(T)
# ---------- end transform ----------

start = Button()
stop = Button()
step = Button()
back = Button()
reset_2 = Button()
full = Button()
list_6 = ValueList({"20", "50", "100", "500", "1000", "5000"}, selected="500")

show_face_until_key = BooleanToggle(False)
show_current_face = BooleanToggle(True)
# Visualisation Cell Network
show_all = BooleanToggle(True)

list_7 = ValueList({"show all": "show_all", "show until key": "show_until_key", "show nothing": "show_nothing"}, selected="show all")

# ----
# Export to JSON
path = Python3Script()  # -> HERE, DATA, ASSEMBLY
# ---------- path: Python ----------
import os

HERE = os.path.dirname(ghdoc.Path)
DATA = os.path.abspath(os.path.join(HERE, "..", "data"))
ASSEMBLY = os.path.abspath(os.path.join(DATA, "assembly"))

print(HERE)
print(DATA)
print(ASSEMBLY)
# ---------- end path ----------
export = Button()
export_2 = Python3Script(ASSEMBLY=path.ASSEMBLY, my_assembly=transform.my_assembly, export=export)  # -> out; inputs ASSEMBLY: String
# ---------- export_2: Python ----------
import os


    

#print(my_assembly.__data__)
if export:
    #print(DATA)
    filename = "250211_brickwall_2.json"
    PATH = os.path.join(ASSEMBLY, filename)

    # the assembly has to be serialized such that it can be called from CPython
    my_assembly.to_json(PATH, pretty=True)
    print(my_assembly)
# ---------- end export_2 ----------

geo_3 = Geometry(<extrusion referenced from the Rhino model>)  # disabled
geo_4 = Geometry(<extrusion referenced from the Rhino model>)  # disabled
geo_5 = Geometry(<extrusion referenced from the Rhino model>)  # disabled
quad = Quadrangulate(Mesh=geo_3, Angle=0.03490658504, Ratio=0.875)  # -> Mesh, Count; disabled
quad_2 = Quadrangulate(Mesh=geo_5, Angle=0.03490658504, Ratio=0.875)  # -> Mesh, Count; disabled
quad_3 = Quadrangulate(Mesh=geo_4, Angle=0.03490658504, Ratio=0.875)  # -> Mesh, Count; disabled
cell_network = Python3Script(units=[quad_3.Mesh, quad_2.Mesh, quad.Mesh])  # -> out, cell_network; inputs units: list of Mesh; disabled
# ---------- cell_network: Python ----------
from climate_active_envelopes.assembly import CAEComponent as component
from compas_rhino.conversions import mesh_to_compas
from compas.datastructures import CellNetwork

mesh_units = []

for unit in units:
    mesh_units.append(mesh_to_compas(unit))
 
#create an empty CellNetwork
cell_network = CellNetwork()

cell_network = component.create_cell_network(mesh_units, cell_network)
print(cell_network)

# for mesh in mesh_units:
#     fkeys = []
#     for fkey in mesh.faces():
#         face_vertices = []
#         for vkey in mesh.face_vertices(fkey):
#             x, y, z = mesh.vertex_coordinates(vkey)
#             vertex = component.find_or_add_vertex(cell_network, x, y, z)
#             face_vertices.append(vertex)
#         fkey = cell_network.add_face(face_vertices)
#         fkeys.append(fkey)
#     cell_network.add_cell(fkeys)

# print(cell_network)



# for box in boxes:
#     b = box_to_compas(box)
#     m = Mesh(b)


# cell_groups = [
#     all_meshes[0:6],  # First cell
#     all_meshes[6:11]  # Second cell
# ]

# for cell_meshes in cell_groups:
#     fkeys = []
#     for mesh in cell_meshes:
#         # Extract vertices and faces from the mesh
#         for fkey in mesh.faces():
#             face_vertices = []
#             for vkey in mesh.face_vertices(fkey):
#                 x, y, z = mesh.vertex_coordinates(vkey)
#                 vertex = component.find_or_add_vertex(cell_network, x, y, z)
#                 face_vertices.append(vertex)
#             fkey = cell_network.add_face(face_vertices)
#             fkeys.append(fkey)
#     cell_network.add_cell(fkeys)

# print(cell_network)
# ---------- end cell_network ----------
cell_network_2 = Panel(cell_network.out)  # disabled

# ----
# Create a Cell network
geo_6 = Geometry(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)
geo_7 = Geometry(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)

quad_4 = Quadrangulate(Mesh=geo_7, Angle=0.03490658504, Ratio=0.875)  # -> Mesh, Count
quad_5 = Quadrangulate(Mesh=geo_6, Angle=0.03490658504, Ratio=0.875)  # -> Mesh, Count
cell_network_3 = Python3Script(units=[quad_5.Mesh, quad_4.Mesh])  # -> out, cell_network; inputs units: list of Mesh; same code as cell_network

cell_network_4 = Panel(cell_network_3.out)

face_types = Python3Script(cell_network=cell_network_3.cell_network, next_face=next_face, previous_face=previous_face, reset=reset)  # -> out, all_faces_type, current_face_type, neighbor_faces_type, cell_network, fkey
# ---------- face_types: Python ----------
from climate_active_envelopes.assembly import CAEComponent as component
from scriptcontext import sticky as st

#st["edge_key"] = edge_key
#st["face_key"] = face_key


L = range(cell_network.number_of_faces())

#store data in component
guid = str(ghenv.Component.InstanceGuid)
face_key = "key_" + guid
running_key = "running_" + guid



if face_key not in st:
    st[face_key] = 0

if next_face:
    if st[face_key] < len(L) - 1:
        st[face_key] += 1
    else:
        st[face_key] = 0 

if previous_face:
    if st[face_key] < len(L) - 1:
        st[face_key] -= 1
    else:
        st[face_key] = 0 

if reset:
    st[face_key] = 0
    st[running_key] = False

fkey = st[face_key]+1


#Category for all faces in all cells
all_faces_type = []
for face, cell in component.sort_faces_by_type(cell_network):
    all_faces_type.append(cell_network.face_attribute(face, 'face_type'))

# Category for selected face
current_face, current_face_type = component.select_face_by_fkey(cell_network, fkey)


# Category of neighboring faces
neighbor_faces_type = []
neighbors, neighbor_face_types = (component.select_face_neighbors(cell_network, fkey))
for neighbor, face_type in neighbor_face_types:
    neighbor_faces_type.append(face_type)


wall_neighbors = []
slab_neighbors = []
neighbors, neighbor_face_types = component.select_face_neighbors(cell_network, fkey)

for neighbor, face_type in neighbor_face_types:
    if face_type in ["outer wall", "inner wall"]:
        wall_neighbors.append(neighbor)

    if face_type in ["slab"]:
        slab_neighbors.append(neighbor)



# Store wall_neighbors and slab_neighbors in cell_network
cell_network.wall_neighbors = wall_neighbors
cell_network.slab_neighbors = slab_neighbors

# Store face_key to the cell_network
cell_network.fkey = fkey

# Store current_face with fkey in cell_network
cell_network.current_face = current_face
cell_network.current_face_type = current_face_type

# Store all faces in cell network
all_faces = []
for face, cell in component.sort_faces_by_type(cell_network):
    face_types = cell_network.face_attribute(face, 'face_type')
    all_faces.append((face, face_types))
cell_network.all_faces = all_faces
# ---------- end face_types ----------
panel_3 = Panel(face_types.fkey)

next_neighbor = Button()
edge_types = Python3Script(cell_network=face_types.cell_network, next_neighbor=next_neighbor)  # -> out, shared_edge_type, cell_network, ekey
# ---------- edge_types: Python ----------
from climate_active_envelopes.assembly import CAEComponent as component
from compas_rhino.conversions import mesh_to_rhino, line_to_rhino

from scriptcontext import sticky as st

face_neighbors = cell_network.wall_neighbors + cell_network.slab_neighbors
L = range(len(cell_network.wall_neighbors))

#store data in component
guid = str(ghenv.Component.InstanceGuid)
edge_key = "key_" + guid

if edge_key not in st:
    st[edge_key] = 0

if next_neighbor:
    if st[edge_key] < len(L) - 1:
        st[edge_key] += 1
    else:
        st[edge_key] = 0 

ekey = st[edge_key]+1

# Store face_key to the cell_network
cell_network.ekey = ekey

# Get type of the shared edge
shared_edge, edge_type = component.get_shared_edge(cell_network, cell_network.current_face, cell_network.wall_neighbors, ekey)
shared_edge_type = edge_type

# Store edge_type and shared_edge in cell_network
cell_network.shared_edge = shared_edge
cell_network.shared_edge_type = shared_edge_type



# all_faces = cell_network.all_faces
# for i, face in enumerate(cell_network.all_faces): 
#     face_edges = cell_network.face_edges(face[0])
#     for u, v in face_edges:
#         ux, uy, uz = cell_network.vertex_coordinates(u)
#         vx, vy, vz = cell_network.vertex_coordinates(v)     
#         if ux == vx and uz != vz:
#             edge_type = 'corner'
#         else:
#             edge_type = 'beam'
#         cell_network.edge_attribute((u, v), 'edge_type', edge_type)
#         print((u, v), edge_type)
# ---------- end edge_types ----------
panel_4 = Panel(edge_types.ekey)
panel_5 = Panel(edge_types.shared_edge_type)

opening = Python3Script(cell_network=edge_types.cell_network, curve=crv_2, plane=pln_2, x=x, y=y, z=z)  # -> out, rhino_curve, target_plane, cell_network; inputs curve: Curve, plane: Plane, x: Double, y: Double, z: Double
# ---------- opening: Python ----------
from climate_active_envelopes.assembly import CAEComponent as component
from compas_rhino.conversions import curve_to_compas, line_to_rhino, curve_to_rhino, plane_to_compas_frame, frame_to_rhino_plane
from compas.geometry import Frame, Transformation, Point, Line, Translation, Vector



compas_line = curve_to_compas(curve)
frame = plane_to_compas_frame(plane)

if cell_network.current_face_type == 'outer wall':

    vertices = cell_network.face_vertices(cell_network.current_face)
    target_point = cell_network.vertex_coordinates(vertices[0])

    face_normal = cell_network.face_normal(cell_network.current_face)
    print(face_normal)
    x_direction = Vector(face_normal[0], face_normal[1] ,face_normal[2])

    z_direction = Vector(0, 0, 1)
    y_direction = z_direction.cross(x_direction)


    target_frame = Frame(target_point, x_direction, y_direction)

    

    T1 = Transformation.from_frame_to_frame(frame, target_frame)
    transformed_line = compas_line.transformed(T1)
    

    shift_x = face_normal[0] * x
    shift_y = face_normal[0] * y
    shift_z = face_normal[0] * z

    T2 = Translation.from_vector([shift_x, shift_y, shift_z])
    shifted_transformed_line = transformed_line.transformed(T2)

    
    rhino_curve = curve_to_rhino(shifted_transformed_line)

#outer_wall_attrs = component.outer_wall_attributes(cell_network, shifted_transformed_line)







# if cell_network.current_face_type == 'outer wall':

#     vertices = cell_network.face_vertices(cell_network.current_face)
#     target_point = cell_network.vertex_coordinates(vertices[0])

#     face_normal = cell_network.face_normal(cell_network.current_face)
#     x_direction = Vector(face_normal[0], face_normal[1] ,face_normal[2])

#     z_direction = Vector(0, 0, 1)
#     y_direction = z_direction.cross(x_direction)


#     target_frame = Frame(target_point, x_direction, y_direction)
#     target_plane = frame_to_rhino_plane(target_frame)
    

#     T = Transformation.from_frame_to_frame(frame, target_frame)
#     transformed_line = compas_line.transformed(T)
    

#     translation = Translation.from_vector([shift_x, 0, shift_z])
#     shifted_transformed_line = transformed_line.transformed(translation)

    
#     rhino_curve = curve_to_rhino(shifted_transformed_line)

# outer_wall_attrs = component.outer_wall_attributes(cell_network, shifted_transformed_line)


# # Print the face type and window attribute
# for face, attributes in outer_wall_attrs.items():
#     face_type = attributes.get('face_type')
#     has_window = 'window' in attributes
#     print(f"Face: {face}, Type: {face_type}, Has Window: {has_window}")
# ---------- end opening ----------

# ----
# Slicing mesh input
layer_height_2 = Slider(0.1, range=0..1)
create_brick_assembly = BooleanToggle(True)
contour_face = Python3Script(cell_network=opening.cell_network, create_brick_assembly=create_brick_assembly, layer_height=layer_height_2)  # -> out, curves, mesh, contour_lines; inputs layer_height: Double
# ---------- contour_face: Python ----------
from climate_active_envelopes.assembly import CAEComponent as component
from compas.datastructures import Mesh
from compas.geometry import Plane, Vector, intersection_line_plane, Frame
from compas_rhino.conversions import point_to_rhino, mesh_to_rhino
import Rhino.Geometry as rg


vertices = cell_network.face_vertices(cell_network.current_face)

face_mesh = cell_network.faces_to_mesh([cell_network.current_face])
mesh = mesh_to_rhino(face_mesh) 


start_point = cell_network.vertex_coordinates(vertices[0])
start_pt = point_to_rhino(start_point)

end_point = cell_network.vertex_coordinates(vertices[-1])
end_pt = point_to_rhino(end_point)


#start_frame = Frame(start_point, [0,1,0], [0,0,1])
#end_frame = Frame(end_point, [0,1,0], [0,0,1])


curves =rg.Mesh.CreateContourCurves(mesh, start_pt,  end_pt, layer_height)

if create_brick_assembly:
    contour_lines = curves













num_layers = int((end_point[2] - start_point[2]) / layer_height)



compas_mesh = cell_network.faces_to_mesh([cell_network.current_face])
# ---------- end contour_face ----------
crv_3 = Curve(contour_face.curves)

panel_6 = Panel(face_types.all_faces_type)
panel_7 = Panel(face_types.current_face_type)
panel_8 = Panel(face_types.neighbor_faces_type)

crv_4 = Curve(opening.rhino_curve)
pln_4 = Plane(opening.target_plane)
calculate_bricks_in_face = Python3Script(cell_network=opening.cell_network)  # -> out, cell_network
# ---------- calculate_bricks_in_face: Python ----------
from climate_active_envelopes.assembly import CAEComponent as component
from compas_rhino.conversions import curve_to_compas, line_to_rhino, curve_to_rhino, plane_to_compas_frame, frame_to_rhino_plane
from compas.geometry import Frame, Transformation, Point, Line, Translation, Vector



compas_line = curve_to_compas(curve)
frame = plane_to_compas_frame(plane)

if cell_network.current_face_type == 'outer wall':

    vertices = cell_network.face_vertices(cell_network.current_face)
    target_point = cell_network.vertex_coordinates(vertices[0])

    face_normal = cell_network.face_normal(cell_network.current_face)
    print(face_normal)
    x_direction = Vector(face_normal[0], face_normal[1] ,face_normal[2])

    z_direction = Vector(0, 0, 1)
    y_direction = z_direction.cross(x_direction)


    target_frame = Frame(target_point, x_direction, y_direction)

    

    T1 = Transformation.from_frame_to_frame(frame, target_frame)
    transformed_line = compas_line.transformed(T1)
    

    shift_x = face_normal[0] * x
    shift_y = face_normal[0] * y
    shift_z = face_normal[0] * z

    T2 = Translation.from_vector([shift_x, shift_y, shift_z])
    shifted_transformed_line = transformed_line.transformed(T2)

    
    rhino_curve = curve_to_rhino(shifted_transformed_line)

outer_wall_attrs = component.outer_wall_attributes(cell_network, shifted_transformed_line)







# if cell_network.current_face_type == 'outer wall':

#     vertices = cell_network.face_vertices(cell_network.current_face)
#     target_point = cell_network.vertex_coordinates(vertices[0])

#     face_normal = cell_network.face_normal(cell_network.current_face)
#     x_direction = Vector(face_normal[0], face_normal[1] ,face_normal[2])

#     z_direction = Vector(0, 0, 1)
#     y_direction = z_direction.cross(x_direction)


#     target_frame = Frame(target_point, x_direction, y_direction)
#     target_plane = frame_to_rhino_plane(target_frame)
    

#     T = Transformation.from_frame_to_frame(frame, target_frame)
#     transformed_line = compas_line.transformed(T)
    

#     translation = Translation.from_vector([shift_x, 0, shift_z])
#     shifted_transformed_line = transformed_line.transformed(translation)

    
#     rhino_curve = curve_to_rhino(shifted_transformed_line)

# outer_wall_attrs = component.outer_wall_attributes(cell_network, shifted_transformed_line)


# # Print the face type and window attribute
# for face, attributes in outer_wall_attrs.items():
#     face_type = attributes.get('face_type')
#     has_window = 'window' in attributes
#     print(f"Face: {face}, Type: {face_type}, Has Window: {has_window}")
# ---------- end calculate_bricks_in_face ----------
create_mesh_with_opening = Python3Script(x=opening.cell_network)  # -> out, a
# ---------- create_mesh_with_opening: Python ----------
def create_face_with_window_mesh(cell_network, face_key, window_curve):
    # Retrieve the vertices of the face
    face_vertices = cell_network.face_vertices(face_key)
    face_coords = [cell_network.vertex_coordinates(vkey) for vkey in face_vertices]

    # Create a mesh from the face vertices
    face_polygon = Polygon(face_coords)
    face_mesh = Mesh.from_vertices_and_faces(face_polygon.vertices, [face_polygon.edges])

    # Convert the window curve to a polygon
    window_polygon = Polygon(window_curve.points)

    # Add the window as a hole in the mesh
    face_mesh.add_face(window_polygon.vertices, is_hole=True)

    return face_mesh



window_curve = shifted_transformed_line  # Replace with the actual window curve
face_mesh = create_face_with_window_mesh(cell_network, face_key, window_curve)
# ---------- end create_mesh_with_opening ----------
calculate_bricks_in_face_2 = Python3Script(contour_lines=contour_face.contour_lines, brick_full=part.full_brick, wall_system=list_5, plane=pln)  # -> out, cell_network; inputs contour_lines: list of Curve
# ---------- calculate_bricks_in_face_2: Python ----------
from climate_active_envelopes.assembly import CAEAssembly as assembly
from compas_rhino.conversions import curve_to_compas, line_to_rhino, curve_to_rhino, plane_to_compas_frame, frame_to_rhino_plane, point_to_compas
from compas.geometry import Frame, Transformation, Point, Line, Translation, Vector
import math as m

brick_parameters = []

brick_length = brick_full.shape.ysize
brick_height = brick_full.shape.zsize
brick_width = brick_full.shape.xsize
brick_spacing = 0.015



courses = len(contour_lines)
center_frame = plane_to_compas_frame(plane)


for curve in contour_lines:
    curve_midpoint = (contour_lines[0].PointAtStart + contour_lines[0].PointAtEnd) / 2


contour_curves = contour_lines

for course, contour_curve in enumerate(contour_curves):
    # Skip last course
    if course == len(contour_curves) - 1:
        continue

    curve_length = abs(contour_curve.GetLength())
    bricks_per_course = m.floor(curve_length / ((brick_width + brick_length) / 2 + brick_spacing))

    # Calculate the direction vector of the curve
    direction_vector = contour_curve.PointAtEnd - contour_curve.PointAtStart
    direction_vector.Unitize()
    T = direction_vector * (abs(brick_length) + abs(brick_spacing))
    initial_brick_center = contour_curve.PointAtStart + T       

    #check if course is odd or even   
    course_is_even = course % 2 == 0
    course_is_odd = course  %2 != 0 
    total_length = bricks_per_course * brick_length + (bricks_per_course - 1) * brick_spacing
    print(total_length)
    
# for course, line in enumerate(contour_lines):

#     line_length = abs(line.Length)
#     bricks_per_course = m.floor(line_length / ((brick_width + brick_length) / 2 + brick_spacing))

#     # Calculate the direction vector of the line
#     direction_vector = line.To - line.From
#     direction_vector.Unitize()
#     T = direction_vector * (abs(brick_length) + abs(brick_spacing))
#     initial_brick_center = line.From + T

#     #check if course is odd or even   
#     course_is_even = course % 2 == 0
#     course_is_odd = course  %2 != 0 

#     brick_parameters.append((bricks_per_course, course_is_odd, direction_vector, initial_brick_center))
# print(brick_parameters)
# ---------- end calculate_bricks_in_face_2 ----------

vizualize_cell_network = Python3Script(
    cell_network=face_types.cell_network,
    show_all=show_all,
    show_current_face=show_current_face,
    show_face_until_key=show_face_until_key)  # -> P, L, M, mesh_till_key, current_mesh
# ---------- vizualize_cell_network: Python ----------
from compas.geometry import Frame
from compas_rhino.conversions import frame_to_rhino, line_to_rhino, mesh_to_rhino
from climate_active_envelopes.assembly import CAEComponent as component
from scriptcontext import sticky as st


fkey = cell_network.fkey


if show_all:
    P = []
    for vertex_key in cell_network.vertices():
        coordinates = cell_network.vertex_coordinates(vertex_key)
        #print(f"Vertex Key: {vertex_key}, Coordinates: {coordinates}")
        frames = Frame(coordinates, [1, 0, 0], [0, 1, 0])
        rhino_planes = frame_to_rhino(frames)
        P.append(rhino_planes)

    L = []
    for edge in cell_network.edges():
        line = cell_network.edge_line(edge)
        curves = line_to_rhino(line)
        L.append(curves)

    M = []
    for face in cell_network.faces():
        face_meshes = cell_network.faces_to_mesh([face])
        mesh = mesh_to_rhino(face_meshes)
        M.append(mesh)

if show_face_until_key:
    all_face_meshes = []
    for face in cell_network.faces():
        face_mesh = cell_network.faces_to_mesh([face])
        all_face_meshes.append(face_mesh)
    mesh_till_key = [mesh_to_rhino(face_mesh) for face_mesh in all_face_meshes[:int(fkey)]]

if show_current_face:
    #current_mesh = []
    selected_face, face_type = component.select_face_by_fkey(cell_network, fkey)
    current_face_mesh = cell_network.faces_to_mesh([selected_face])
    current_mesh = mesh_to_rhino(current_face_mesh) 


# wall_neighbors = []
# slab_neighbors = []
# neighbors, neighbor_face_types = component.select_face_neighbors(cell_network, fkey)
# for neighbor, face_type in neighbor_face_types:
#     if show_wall_neighbors:
#         if face_type in ["outer wall", "inner wall"]:
#             neighbor_faces_meshes = cell_network.faces_to_mesh([neighbor])
#             mesh_neighbor = mesh_to_rhino(neighbor_faces_meshes)
#             wall_neighbors.append(mesh_neighbor)
#     if show_slab_neighbors:
#         if face_type in ["slab"]:
#             neighbor_faces_meshes = cell_network.faces_to_mesh([neighbor])
#             mesh_neighbor = mesh_to_rhino(neighbor_faces_meshes)
#             slab_neighbors.append(mesh_neighbor)
# ---------- end vizualize_cell_network ----------
points = Point(vizualize_cell_network.P)

vizualize_face_neighbors = Python3Script(
    cell_network=edge_types.cell_network,
    show_wall_neighbors=show_wall_neighbors,
    show_slab_neighbors=show_slab_neighbors,
    show_inner_wall_neighbors=show_inner_wall_neighbors,
    show_face_neighbor=show_face_neighbor,
    show_face_neighbor_unil_key=show_face_neighbor_until_key)  # -> out, wall_neighbors, slab_neighbors, inner_wall_neighbors, next_neighbor, neighbor_until_key
# ---------- vizualize_face_neighbors: Python ----------
from climate_active_envelopes.assembly import CAEComponent as component
from compas_rhino.conversions import mesh_to_rhino, line_to_rhino

from scriptcontext import sticky as st

# face_neighbors = cell_network.wall_neighbors + cell_network.slab_neighbors
# L = range(len(cell_network.wall_neighbors))

# #store data in component
# guid = str(ghenv.Component.InstanceGuid)
# edge_key = "key_" + guid

# if edge_key not in st:
#     st[edge_key] = 0

# if next_neighbor:
#     if st[edge_key] < len(L) - 1:
#         st[edge_key] += 1
#     else:
#         st[edge_key] = 0 

# ekey = st[edge_key]+1

ekey = cell_network.ekey
fkey = cell_network.fkey


wall_neighbors = []
slab_neighbors = []
neighbors, neighbor_face_types = component.select_face_neighbors(cell_network, fkey)

for neighbor, face_type in neighbor_face_types:
    if show_wall_neighbors:
        if face_type in ["outer wall", "inner wall"]:
            neighbor_faces_meshes = cell_network.faces_to_mesh([neighbor])
            mesh_neighbor = mesh_to_rhino(neighbor_faces_meshes)
            wall_neighbors.append(mesh_neighbor)
    if show_slab_neighbors:
        if face_type in ["slab"]:
            neighbor_faces_meshes = cell_network.faces_to_mesh([neighbor])
            mesh_neighbor = mesh_to_rhino(neighbor_faces_meshes)
            slab_neighbors.append(mesh_neighbor)



edge_type = cell_network.shared_edge_type
shared_edge = cell_network.shared_edge


inner_wall_neighbors = []
edge_faces = cell_network.edge_faces(shared_edge)
if show_inner_wall_neighbors:
    for face in edge_faces:
         if face != cell_network.current_face:
            if edge_type == 'inner wall joint':
                neighbor = mesh_to_rhino(cell_network.faces_to_mesh([face]))
                inner_wall_neighbors.append(neighbor)
            else:
                neighbor = mesh_to_rhino(cell_network.faces_to_mesh([face]))
                inner_wall_neighbors.append(neighbor)

neighbor_face_meshes = []
for i, face in enumerate(cell_network.wall_neighbors):
    if i < ekey:

        #Vizualize the neighboring faces (one-by-one and until key)
        if show_face_neighbor:
            next_neighbor = mesh_to_rhino(cell_network.faces_to_mesh([face]))

        if show_face_neighbor_unil_key:
            neighbor_face_meshes.append(cell_network.faces_to_mesh([face]))
            neighbor_until_key = [mesh_to_rhino(face_mesh) for face_mesh in neighbor_face_meshes[:int(ekey)]]






#Vizualize the shared edge
shared_edge = component.get_shared_edge(cell_network, cell_network.current_face, cell_network.wall_neighbors, ekey)
shared_edge_type = shared_edge[1]
edge_between_faces = []
line = cell_network.edge_line(shared_edge[0])
curves = line_to_rhino(line)
edge_between_faces.append(curves)
# ---------- end vizualize_face_neighbors ----------

crv_5 = Curve(vizualize_cell_network.L)

preview = CustomPreview(Geometry=vizualize_cell_network.mesh_till_key, Material=ColourSwatch(SwatchColor=RGB(255, 125, 157)))
preview_2 = CustomPreview(Geometry=vizualize_cell_network.current_mesh, Material=ColourSwatch(SwatchColor=RGB(255, 194, 157)))

preview_3 = CustomPreview(
    Geometry=[vizualize_face_neighbors.wall_neighbors, vizualize_face_neighbors.slab_neighbors],
    Material=ColourSwatch(SwatchColor=RGB(181, 125, 157)))
preview_4 = CustomPreview(
    Geometry=[vizualize_face_neighbors.inner_wall_neighbors, vizualize_face_neighbors.next_neighbor],
    Material=ColourSwatch(SwatchColor=RGB(255, 216, 203)))
preview_5 = CustomPreview(Geometry=vizualize_face_neighbors.neighbor_until_key, Material=ColourSwatch(SwatchColor=RGB(255, 131, 138)))

# ----
# Radiation Simulation
toggle_3 = BooleanToggle(False)

# ----
# Visualisation Dashboard
counter = Python3Script(
    my_assembly=transform.my_assembly,
    start=start,
    stop=stop,
    step=step,
    step_back=back,
    reset=reset_2,
    full=full,
    interval=list_6)  # -> out, counter
# ---------- counter: Python ----------
from scriptcontext import sticky as st
import Grasshopper

def update_component(ghenv, delay):
    """Schedule an update of the Grasshopper component.

    After the specified delay, the GH component will be automatically updated.

    Parameters
    ----------
    ghenv : :class:`GhPython.Component.PythonEnvironment`
        The current GHPython environment.
    delay : :obj:`int`
        Time in milliseconds until the update is performed.

    Raises
    ------
    ValueError
        If the delay is less than zero.

    """
    if delay <= 0:
        raise ValueError("Delay must be greater than zero")

    ghcomp = ghenv.Component
    ghdoc = ghcomp.OnPingDocument()

    def callback(ghdoc):
        if ghdoc.SolutionState != Grasshopper.Kernel.GH_ProcessStep.Process:
            ghcomp.ExpireSolution(False)

    ghdoc.ScheduleSolution(delay, Grasshopper.Kernel.GH_Document.GH_ScheduleDelegate(callback))

L = range(my_assembly.graph.number_of_nodes())

# store data in component
guid = str(ghenv.Component.InstanceGuid)
counter_key = "counter_" + guid
running_key = "running_" + guid

if counter_key not in st:
    st[counter_key] = 0

if running_key not in st:
    st[running_key] = False
    

if st[running_key]:
    if st[counter_key] < len(L) - 1:
        st[counter_key] += 1
        update_component(ghenv, interval)
    else:
        st[counter_key] = 0
        st[running_key] = False
    
if start:
    st[running_key] = True

if stop:
    st[running_key] = False

if step:
    if st[counter_key] < len(L) - 1:
        st[counter_key] += 1

if step_back:
    if st[counter_key] < len(L) - 1:
        st[counter_key] -= 1

if reset:
    st[counter_key] = 0
    st[running_key] = False

if full:
    st[counter_key] = len(L)-1

if len(L):
    item = L[st[counter_key]]


#st["visualisation_counter"] = st[counter_key]
counter = st[counter_key]+1
# ---------- end counter ----------
panel_9 = Panel(counter.counter)
visualize_2 = Python3Script(my_assembly=transform.my_assembly, show=list_7, highlight_current_part=Toggle(False), counter=panel_9)  # -> out, parts_geometry, parts_frame, current_part_geometry, current_part_frame, current_part_gripping_frame
# ---------- visualize_2: Python ----------
from compas_rhino.conversions import mesh_to_rhino, box_to_rhino, frame_to_rhino

#print assembly
print(my_assembly)
#counter = int(counter)

#get parts datastructure
parts = [p for p in my_assembly.parts()]

#get current part

#if show_wall == True:

if show == "show_all":
    
#get parts datastructure
    parts = [p for p in my_assembly.parts()]
    parts_geometry = []
    parts_frame = []

    #part = parts[0]
    #print(part.gripping_frame)

    #extract the mesh of the parts for visulization (+ converted to rhino mesh)
    parts_geometry = [mesh_to_rhino(p.mesh) for p in parts]
    
    #extract the frame of the parts for visulization (+ converted to rhino plane)
    parts_frame = [frame_to_rhino(p.frame) for p in parts]
    #print(parts_geometry)

    key = my_assembly.graph.number_of_nodes()-1

if show == "show_until_key":
    #extract the mesh of the parts for visulization (+ converted to rhino mesh)
    parts_geometry = [mesh_to_rhino(p.mesh) for p in parts[0:int(counter)]]
    
    #extract the frame of the parts for visulization (+ converted to rhino plane)
    parts_frame = [frame_to_rhino(p.frame) for p in parts[0:int(counter)]]

    key = int(counter)-1

if show == "show_nothing":
    print("Nothing to see")
    pass

if highlight_current_part:
    current_part = my_assembly.part(key)
    current_part_geometry = mesh_to_rhino(current_part.mesh)
    current_part_frame = frame_to_rhino(current_part.frame)
    current_part_gripping_frame = frame_to_rhino(current_part.gripping_frame)
    
    print(current_part.__data__)
# ---------- end visualize_2 ----------
panel_10 = Panel(visualize_2.out)

radiation_simulation = RadiationSimulation(
    sky_mtx=sun_hours.sky_mtx,
    geometry=visualize_2.parts_geometry,
    context=context_input,
    offset_dist=number_slider_2,
    run=toggle_3)  # -> mesh, legend
geo_8 = Geometry(radiation_simulation.legend)
brick_wall = Mesh(radiation_simulation.mesh)

geo_9 = Geometry(visualize_2.parts_geometry)
geo_10 = Geometry(visualize_2.current_part_gripping_frame)
geo_11 = Geometry(visualize_2.parts_frame)
geo_12 = Geometry([visualize_2.current_part_frame, visualize_2.current_part_geometry])
preview_6 = CustomPreview(Geometry=geo_9, Material=ColourSwatch(SwatchColor=RGB(196, 141, 141)))
preview_7 = CustomPreview(Geometry=geo_11, Material=ColourSwatch(SwatchColor=RGB(255, 125, 157)))
preview_8 = CustomPreview(Geometry=geo_12, Material=ColourSwatch(SwatchColor=RGB(255, 125, 157)))
preview_9 = CustomPreview(Geometry=geo_10, Material=ColourSwatch(SwatchColor=RGB(255, 125, 157)))

draw_2 = Python3Script(planes=geo_10, scale=Slider(0.2, range=0..1))  # -> out, P, V, C, W; inputs planes: list of Plane
# ---------- draw_2: Python ----------
from System.Drawing import Color

red = Color.FromArgb(255, 0, 0)
green = Color.FromArgb(0, 255, 0)
blue = Color.FromArgb(0, 0, 255)

P = []
V = []
C = []

scale = float(scale)

for plane in planes:
    if not plane:
        continue
    P += [plane.Origin] * 3
    V.append(plane.XAxis * scale)
    V.append(plane.YAxis * scale)
    V.append(plane.ZAxis * scale)
    C += [red, green, blue]

W = 3
# ---------- end draw_2 ----------
vdisex = VectorDisplayEx(Point=draw_2.P, Vector=draw_2.V, Colour=draw_2.C, Width=draw_2.W)

# ==== cluster SunHours
epw_file = ClusterInput()
start_month = ClusterInput()
start_day = ClusterInput()
start_hour = ClusterInput()
end_month = ClusterInput()
end_day = ClusterInput()
end_hour = ClusterInput()
importepw = LBImportEPW(epw_file=epw_file)  # -> location, dry_bulb_temperature, dew_point_temperature, relative_humidity, wind_speed, wind_direction, direct_normal_rad, diffuse_horizontal_rad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; plug-in component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
analysisperiod = LBAnalysisPeriod(
    start_month=start_month,
    start_day=start_day,
    start_hour=start_hour,
    end_month=end_month,
    end_day=end_day,
    end_hour=end_hour)  # -> period, hoys, dates; plug-in component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
north = ClusterInput()
hoys = ClusterOutput(analysisperiod.hoys)
skymatrix = LBCumulativeSkyMatrix(
    north=north,
    location=importepw.location,
    direct_rad=importepw.direct_normal_rad,
    diffuse_rad=importepw.diffuse_horizontal_rad,
    hoys=analysisperiod.hoys)  # -> report, sky_mtx; plug-in component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
location = ClusterOutput(importepw.location)
sky_mtx = ClusterOutput(skymatrix.sky_mtx)
colrange = LBColorRange(index=Slider(5, range=0..100))  # -> colors; plug-in component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
geometry = ClusterInput()
context = ClusterInput()
grid_size = ClusterInput()
offset_dist = ClusterInput()
run = ClusterInput()
legendpar = LBLegendParameters(colors=colrange)  # -> leg_par; plug-in component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
incidentradiation = LBIncidentRadiation(
    sky_mtx=skymatrix.sky_mtx,
    geometry=flatten(geometry),
    context=flatten(context),
    grid_size=grid_size,
    offset_dist=offset_dist,
    legend_par=legendpar,
    run=run)  # -> report, points, results, total, mesh, legend, title, int_mtx; plug-in component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
results = ClusterOutput(incidentradiation.results)
mesh = ClusterOutput(incidentradiation.mesh)
legend = ClusterOutput(incidentradiation.legend)

# ==== cluster RadiationSimulation
colrange = LBColorRange(index=Slider(0, range=0..100))  # -> colors; plug-in component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
sky_mtx = ClusterInput()
geometry = ClusterInput()
context = ClusterInput()
offset_dist = ClusterInput()
run = ClusterInput()
legendpar = LBLegendParameters(colors=colrange)  # -> leg_par; plug-in component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
incidentradiation = LBIncidentRadiation(
    sky_mtx=sky_mtx,
    geometry=flatten(geometry),
    context=flatten(context),
    grid_size=Slider(1, range=0..1),
    offset_dist=offset_dist,
    legend_par=legendpar,
    run=run)  # -> report, points, results, total, mesh, legend, title, int_mtx; plug-in component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
legend = ClusterOutput(incidentradiation.legend)
mesh = ClusterOutput(incidentradiation.mesh)
